# Grasshopper definition energyModel.gh (Grasshopper 1.0.8)
# plug-ins: RhinoCodePluginGH, Bifocals

# ---- group: Ladeplatzt
geometry = Geometry([<surface referenced from the Rhino model> x5, <curve referenced from the Rhino model>])

# ---- group: Raum 1
geometry_2 = Geometry([<mesh referenced from the Rhino model> x3])

# ---- group: Raum 2
geometry_3 = Geometry([<mesh referenced from the Rhino model> x3])

# ---- group: Solar Panelen
geometry_4 = Geometry(<mesh referenced from the Rhino model>)

# ----
zeit = Slider(19, range=0..23)
panel = Panel("C:\Users\HP\OneDrive\Documentos\martin\martin\Uni\elfathon\Raum1_Strom.csv")
panel_2 = Panel("C:\Users\HP\OneDrive\Documentos\martin\martin\Uni\elfathon\Raum2_Strom.csv")
panel_3 = Panel("C:\Users\HP\OneDrive\Documentos\martin\martin\Uni\elfathon\Temperatur_Raum_1.csv")
panel_4 = Panel("C:\Users\HP\OneDrive\Documentos\martin\martin\Uni\elfathon\Temperatur_Raum_2.csv")
panel_5 = Panel("C:\Users\HP\OneDrive\Documentos\martin\martin\Uni\elfathon\Photovoltaik.csv")
panel_6 = Panel("C:\Users\HP\OneDrive\Documentos\martin\martin\Uni\elfathon\Hauptbau_Verbrauch.csv")
file_path = FilePath(panel)
file_path_2 = FilePath(panel_2)
file_path_3 = FilePath(panel_3)
file_path_4 = FilePath(panel_4)
file_path_5 = FilePath(panel_5)
file_path_6 = FilePath(panel_6)
read_file = ReadFile(File=file_path, PerLineParse=True)
read_file_2 = ReadFile(File=file_path_2, PerLineParse=True)
read_file_3 = ReadFile(File=file_path_3, PerLineParse=True)
read_file_4 = ReadFile(File=file_path_4, PerLineParse=True)
read_file_5 = ReadFile(File=file_path_5, PerLineParse=True)
read_file_6 = ReadFile(File=file_path_6, PerLineParse=True)
text_split = TextSplit(Text=read_file_6, Separators=";")
text_split_2 = TextSplit(Text=read_file, Separators=";")
text_split_3 = TextSplit(Text=read_file_2, Separators=";")
text_split_4 = TextSplit(Text=read_file_3, Separators=";")
text_split_5 = TextSplit(Text=read_file_4, Separators=";")
text_split_6 = TextSplit(Text=read_file_5, Separators=";")
list_item = ListItem(List=text_split_2, Index="1", Wrap=True)  # -> flatten(Item)
list_item_2 = ListItem(List=text_split, Index="1", Wrap=True)  # -> flatten(Item)
cull_index = CullIndex(List=list_item_2, Indices="0", Wrap=True)
list_item_3 = ListItem(List=text_split_3, Index="1", Wrap=True)  # -> flatten(Item)
list_item_4 = ListItem(List=text_split_4, Index="1", Wrap=True)  # -> flatten(Item)
list_item_5 = ListItem(List=text_split_6, Index="1", Wrap=True)  # -> flatten(Item)
list_item_6 = ListItem(List=text_split_5, Index="1", Wrap=True)  # -> flatten(Item)
panel_7 = Panel(cull_index)
cull_index_2 = CullIndex(List=list_item, Indices="0", Wrap=True)
cull_index_3 = CullIndex(List=list_item_3, Indices="0", Wrap=True)
cull_index_4 = CullIndex(List=list_item_4, Indices="0", Wrap=True)
cull_index_5 = CullIndex(List=list_item_5, Indices="0", Wrap=True)
cull_index_6 = CullIndex(List=list_item_6, Indices="0", Wrap=True)
panel_9 = Panel(cull_index_4)
panel_10 = Panel(cull_index_2)
panel_11 = Panel(cull_index_3)
list_item_7 = ListItem(List=cull_index, Index=zeit, Wrap=True)
c_script = CSharpScript(verfuegbareEnergie=list_item_7)  # -> out, Status; inputs verfuegbareEnergie: Double
# ---------- c_script: C# ----------
// Grasshopper Script Instance
#region Usings
using System;
using System.Linq;
using System.Collections;
using System.Collections.Generic;
using System.Drawing;

using Rhino;
using Rhino.Geometry;

using Grasshopper;
using Grasshopper.Kernel;
using Grasshopper.Kernel.Data;
using Grasshopper.Kernel.Types;
#endregion

public class Script_Instance : GH_ScriptInstance
{
    #region Notes
    /* 
      Members:
        RhinoDoc RhinoDocument
        GH_Document GrasshopperDocument
        IGH_Component Component
        int Iteration

      Methods (Virtual & overridable):
        Print(string text)
        Print(string format, params object[] args)
        Reflect(object obj)
        Reflect(object obj, string method_name)
    */
    #endregion

    private void RunScript(double verfuegbareEnergie, ref object Status)
{
  int status = 2; // Standard: Rot (Gesperrt)

  if (verfuegbareEnergie >= -100.0 && verfuegbareEnergie < -10.0) {
    status = 0; // Grün (Aktiv)
  }
  else if (verfuegbareEnergie >= -10.0 && verfuegbareEnergie < 0.0) {
    status = 1; // Gelb (Reduziert)
  }
  // 0 oder größer bleibt 2 (Rot)

  Status = status;
}


}
# ---------- end c_script ----------
stream_filter = StreamFilter(
    Gate=c_script.Status,
    Stream0=ColourSwatch(SwatchColor=RGB(255, 255, 0)),
    Stream1=ColourSwatch(SwatchColor=RGB(255, 134, 0)),
    Stream2=ColourSwatch(SwatchColor=RGB(255, 0, 0)))
panel_12 = Panel(cull_index_6)
panel_13 = Panel(cull_index_5)
geometry_5 = Geometry(<mesh referenced from the Rhino model>)
custom_preview = CustomPreview(Geometry=geometry_5, Material=stream_filter)
list_item_8 = ListItem(List=cull_index_6, Index=zeit, Wrap=True)
list_item_9 = ListItem(List=cull_index_2, Index=zeit, Wrap=True)
list_item_10 = ListItem(List=cull_index_4, Index=zeit, Wrap=True)
list_item_11 = ListItem(List=cull_index_5, Index=zeit, Wrap=True)
list_item_12 = ListItem(List=cull_index_3, Index=zeit, Wrap=True)
list_item_13 = ListItem(List=cull_index_5, Index="-1", Wrap=True)
addition = Addition(A=list_item_9, B=list_item_12)
geometry_6 = Geometry(<surface referenced from the Rhino model>)
geometry_7 = Geometry(<surface referenced from the Rhino model>)
addition_2 = Addition(A=list_item_11, B="30")
smaller_than = SmallerThan(FirstNumber=addition_2, SecondNumber=list_item_7)  # -> SmallerThan, OrEqualTo
subtraction = Subtraction(A=list_item_7, B=addition_2)
panel_14 = Panel(subtraction)
c_script_2 = CSharpScript(verfuegbareEnergie=subtraction)  # -> out, Status; inputs verfuegbareEnergie: Double
# ---------- c_script_2: C# ----------
// Grasshopper Script Instance
#region Usings
using System;
using System.Linq;
using System.Collections;
using System.Collections.Generic;
using System.Drawing;

using Rhino;
using Rhino.Geometry;

using Grasshopper;
using Grasshopper.Kernel;
using Grasshopper.Kernel.Data;
using Grasshopper.Kernel.Types;
#endregion

public class Script_Instance : GH_ScriptInstance
{
    #region Notes
    /* 
      Members:
        RhinoDoc RhinoDocument
        GH_Document GrasshopperDocument
        IGH_Component Component
        int Iteration

      Methods (Virtual & overridable):
        Print(string text)
        Print(string format, params object[] args)
        Reflect(object obj)
        Reflect(object obj, string method_name)
    */
    #endregion

    private void RunScript(double verfuegbareEnergie, ref object Status)
{
  int status = 2; // Standard: Rot (Gesperrt)

  if (verfuegbareEnergie >= -100.0 && verfuegbareEnergie < -19.0) {
    status = 0; // Grün (Aktiv)
  }
  else if (verfuegbareEnergie >= -10.0 && verfuegbareEnergie < -12.0) {
    status = 1; // Gelb (Reduziert)
  }
  // 0 oder größer bleibt 2 (Rot)

  Status = status;
}

}
# ---------- end c_script_2 ----------
c_script_3 = CSharpScript(verfuegbareEnergie=subtraction)  # -> out, Status; inputs verfuegbareEnergie: Double
# ---------- c_script_3: C# ----------
// Grasshopper Script Instance
#region Usings
using System;
using System.Linq;
using System.Collections;
using System.Collections.Generic;
using System.Drawing;

using Rhino;
using Rhino.Geometry;

using Grasshopper;
using Grasshopper.Kernel;
using Grasshopper.Kernel.Data;
using Grasshopper.Kernel.Types;
#endregion

public class Script_Instance : GH_ScriptInstance
{
    #region Notes
    /* 
      Members:
        RhinoDoc RhinoDocument
        GH_Document GrasshopperDocument
        IGH_Component Component
        int Iteration

      Methods (Virtual & overridable):
        Print(string text)
        Print(string format, params object[] args)
        Reflect(object obj)
        Reflect(object obj, string method_name)
    */
    #endregion

    private void RunScript(double verfuegbareEnergie, ref object Status)
{
  int status = 2; // Standard: Rot (Gesperrt)

  if (verfuegbareEnergie >= -100.0 && verfuegbareEnergie < -13.0) {
    status = 0; // Grün (Aktiv)
  }
  else if (verfuegbareEnergie >= -10.0 && verfuegbareEnergie < -3.0) {
    status = 1; // Gelb (Reduziert)
  }
  // 0 oder größer bleibt 2 (Rot)

  Status = status;
}

}
# ---------- end c_script_3 ----------
c_script_4 = CSharpScript(verfuegbareEnergie=subtraction)  # -> out, Status; inputs verfuegbareEnergie: Double
# ---------- c_script_4: C# ----------
// Grasshopper Script Instance
#region Usings
using System;
using System.Linq;
using System.Collections;
using System.Collections.Generic;
using System.Drawing;

using Rhino;
using Rhino.Geometry;

using Grasshopper;
using Grasshopper.Kernel;
using Grasshopper.Kernel.Data;
using Grasshopper.Kernel.Types;
#endregion

public class Script_Instance : GH_ScriptInstance
{
    #region Notes
    /* 
      Members:
        RhinoDoc RhinoDocument
        GH_Document GrasshopperDocument
        IGH_Component Component
        int Iteration

      Methods (Virtual & overridable):
        Print(string text)
        Print(string format, params object[] args)
        Reflect(object obj)
        Reflect(object obj, string method_name)
    */
    #endregion

    private void RunScript(double verfuegbareEnergie, ref object Status)
{
  int status = 2; // Standard: Rot (Gesperrt)

  if (verfuegbareEnergie >= -100.0 && verfuegbareEnergie < -16.0) {
    status = 0; // Grün (Aktiv)
  }
  else if (verfuegbareEnergie >= -10.0 && verfuegbareEnergie < -8.0) {
    status = 1; // Gelb (Reduziert)
  }
  // 0 oder größer bleibt 2 (Rot)

  Status = status;
}

}
# ---------- end c_script_4 ----------
point = Point(<point referenced from the Rhino model>)
panel_15 = Panel("""kWh\n
PV+Speicherung:""")
c_script_5 = CSharpScript(verfuegbareEnergie=subtraction)  # -> out, Status; inputs verfuegbareEnergie: Double; same code as c_script
panel_16 = Panel(c_script_5.Status)
curve = Curve(<curve referenced from the Rhino model>)
dispatch = Dispatch(List=smaller_than.SmallerThan, DispatchPattern=[True, False])  # -> ListA, ListB
stream_filter_2 = StreamFilter(
    Gate=c_script_2.Status,
    Stream0=ColourSwatch(SwatchColor=RGB(0, 255, 0)),
    Stream1=ColourSwatch(SwatchColor=RGB(255, 255, 0)),
    Stream2=ColourSwatch(SwatchColor=RGB(255, 0, 0)))
stream_filter_3 = StreamFilter(
    Gate=smaller_than.SmallerThan,
    Stream0=ColourSwatch(SwatchColor=RGB(0, 255, 0)),
    Stream1=ColourSwatch(SwatchColor=RGB(255, 0, 0)))
stream_filter_4 = StreamFilter(
    Gate=c_script_3.Status,
    Stream0=ColourSwatch(SwatchColor=RGB(0, 255, 0)),
    Stream1=ColourSwatch(SwatchColor=RGB(255, 255, 0)),
    Stream2=ColourSwatch(SwatchColor=RGB(255, 0, 0)))
geometry_8 = Geometry(<surface referenced from the Rhino model>)
stream_filter_5 = StreamFilter(
    Gate=c_script_4.Status,
    Stream0=ColourSwatch(SwatchColor=RGB(0, 255, 0)),
    Stream1=ColourSwatch(SwatchColor=RGB(255, 255, 0)),
    Stream2=ColourSwatch(SwatchColor=RGB(255, 0, 0)))
curve_middle = CurveMiddle(Curve=curve)
concatenate = Concatenate(FragmentA="Verbrauch: ", FragmentB=list_item_7)
geometry_9 = Geometry(<surface referenced from the Rhino model>)
custom_preview_2 = CustomPreview(Geometry=geometry_8, Material=stream_filter_3)
custom_preview_3 = CustomPreview(Geometry=geometry_7, Material=stream_filter_2)
concatenate_2 = Concatenate(FragmentA=concatenate, FragmentB=panel_15)
colour_swatch = ColourSwatch(SwatchColor=RGB(255, 255, 255))
custom_preview_4 = CustomPreview(Geometry=geometry_9, Material=stream_filter_4)
custom_preview_5 = CustomPreview(Geometry=geometry_6, Material=stream_filter_5)
concatenate_3 = Concatenate(FragmentA=concatenate_2, FragmentB=addition_2)
stream_filter_6 = StreamFilter(
    Gate=c_script_5.Status,
    Stream0=ColourSwatch(SwatchColor=RGB(0, 255, 0)),
    Stream1=ColourSwatch(SwatchColor=RGB(255, 255, 0)),
    Stream2=ColourSwatch(SwatchColor=RGB(255, 0, 0)))
concatenate_4 = Concatenate(FragmentA=concatenate_3, FragmentB="kWh")
geometry_10 = Geometry(<brep referenced from the Rhino model>)
text_tag_3d = TextTag3D(Location=point, Text=concatenate_4, Size=0.6, Colour=colour_swatch, Justification=7)
custom_preview_6 = CustomPreview(Geometry=geometry_10, Material=stream_filter_6)
text_tag_3d_2 = TextTag3D(Location=curve_middle, Text="Lastspitzen", Size=1, Colour=colour_swatch, Justification=7)
point_2 = Point(<point referenced from the Rhino model>)
panel_17 = Panel(stream_filter_3)
text_tag_3d_3 = TextTag3D(Location=point_2, Text="Wärmepumpe", Size=0.3, Colour=ColourSwatch(SwatchColor=RGBA(0, 0, 0, 251)), Justification=7)
